# Dynamo graph 10-Read selected elements.dyn (Dynamo 3.3.0.6316)

# group: Read selected elements
select_model_element = DSModelElementSelection()  # 1 picked in the model
name = Element.Name(element=select_model_element)
id = Element.Id(element=select_model_element)
