# Dynamo graph 11-Read parameters of selected element.dyn (Dynamo 3.3.0.6316)

# group: Read parameters of selected element: element.Parameters
select_model_element = DSModelElementSelection()  # 1 picked in the model
parameters = Element.Parameters(element=select_model_element)
name = Parameter.Name(parameter=parameters)
watch = Watch(name)
