# Dynamo graph 12-Read one parameter value.dyn (Dynamo 3.3.0.6316)

# group: Read one parameter value :
# doc.GetElement(element_id).LookupParameter("Comments")
select_model_element = DSModelElementSelection()  # 1 picked in the model
string = StringInput("Comments")
getParameterValueByName = Element.GetParameterValueByName(element=select_model_element, parameterName=string)
