# Dynamo graph 14-Count by category.dyn (Dynamo 3.3.0.6316)

# group: Count by category (Walls): FilteredElementCollector(doc).OfCategory(BuiltInCategory.OST_Walls)
categories = Categories("OST_Walls")
all_elements_of_category = ElementsOfCategory(Category=categories)
count = List.Count(list=all_elements_of_category)
watch = Watch(count)
