# Dynamo graph 15-Count by category.dyn (Dynamo 3.3.0.6316)

# group: Count by category: user selects from list
# FilteredElementCollector(doc).OfCategory(selected_category).WhereElementIsNotElementType().GetElementCount()
categories = Categories("OST_Rooms")
all_elements_of_category = ElementsOfCategory(Category=categories)
count = List.Count(list=all_elements_of_category)
categories_2 = Categories("OST_Levels")
all_elements_of_category_2 = ElementsOfCategory(Category=categories_2)
count_2 = List.Count(list=all_elements_of_category_2)
categories_3 = Categories("OST_Floors")
all_elements_of_category_3 = ElementsOfCategory(Category=categories_3)
count_3 = List.Count(list=all_elements_of_category_3)
