# Dynamo graph 16-Automatically read all categories.dyn (Dynamo 3.3.0.6316)

# group: Automatically read all categories:
python_script = Python()  # CPython3; unwired: IN[0]
# ---------- python_script.python (15 lines) ----------
import clr

clr.AddReference("RevitServices")
from RevitServices.Persistence import DocumentManager

doc = DocumentManager.Instance.CurrentDBDocument

categories = doc.Settings.Categories

category_names = []

for cat in categories:
    category_names.append(cat.Name)

OUT = sorted(category_names)
# ----------------------------------------
watch = Watch(python_script)
