# Dynamo graph 17-Count categories in entire project.dyn (Dynamo 3.3.0.6316)

# group: Count categories in entire project
python_script = Python()  # CPython3; unwired: IN[0]
# ---------- python_script.python (29 lines) ----------
import clr

clr.AddReference("RevitServices")
from RevitServices.Persistence import DocumentManager

clr.AddReference("RevitAPI")
from Autodesk.Revit.DB import FilteredElementCollector

doc = DocumentManager.Instance.CurrentDBDocument

elements = FilteredElementCollector(doc).WhereElementIsNotElementType().ToElements()

category_counts = {}

for element in elements:
    if element.Category:
        category_name = element.Category.Name

        if category_name not in category_counts:
            category_counts[category_name] = 0

        category_counts[category_name] += 1

result = []

for category_name in sorted(category_counts.keys()):
    result.append(category_name + " : " + str(category_counts[category_name]))

OUT = result
# ----------------------------------------
watch = Watch(python_script)
