# Dynamo graph 5-Print project name and path.dyn (Dynamo 3.3.0.6316)

# group: Print project name and path
python_script = Python()  # CPython3; unwired: IN[0]
# ---------- python_script.python (11 lines) ----------
import clr

clr.AddReference("RevitServices")
from RevitServices.Persistence import DocumentManager

doc = DocumentManager.Instance.CurrentDBDocument

project_name = doc.Title
project_path = doc.PathName

OUT = ["Project Name: " + project_name, "Project Path: " + project_path]
# ----------------------------------------
watch = Watch(python_script)  # frozen

# group: Print project name and path: doc.Title, doc.PathName
current = Document.Current()
activeView = Document.ActiveView(document=current)
watch_2 = Watch(activeView)
filePath = Document.FilePath(document=current)
watch_3 = Watch(filePath)
