# Dynamo graph 6-Read all sheets.dyn (Dynamo 3.3.0.6316)

# group: Read all sheets: FilteredElementCollector(doc).OfClass(ViewSheet)
categories = Categories("OST_Sheets")
all_elements_of_category = ElementsOfCategory(Category=categories)
string = StringInput("Sheet Number")
getParameterValueByName = Element.GetParameterValueByName(element=all_elements_of_category, parameterName=string)
string_2 = StringInput("Sheet Name")
getParameterValueByName_2 = Element.GetParameterValueByName(element=all_elements_of_category, parameterName=string_2)
