# Dynamo graph 7-Read all views.dyn (Dynamo 3.3.0.6316)

# group: Read all views: FilteredElementCollector(doc).OfClass(View).ToElements()
categories = Categories("OST_Views")
all_elements_of_category = ElementsOfCategory(Category=categories)
name = Element.Name(element=all_elements_of_category)
watch = Watch(name)
