# Dynamo graph 9-Active View.dyn (Dynamo 3.3.0.6316)

# group: Active View: doc.ActiveView
current = Document.Current()
activeView = Document.ActiveView(document=current)
name = Element.Name(element=activeView)
